# Grasshopper definition scooter_bracket_final.gh (Grasshopper 1.0.7)

spline_adjuster = Slider(-0.27, range=-1..1)
ulock_clip_thickness = Slider(0.43, range=0..1)

# ---- group: Inputs
# Primary Inputs
stem_radius_x = Slider(0.795, range=0..1)
stem_radius_y = Slider(0.655, range=0..1)
u_lock_radius = Slider(0.697, range=0..10)
bracket_height = Slider(2, range=0..5)
bracket_thickness_x = Slider(0.25, range=0..1)
bracket_thickness_y = Slider(0.3, range=0..1)
flange_height_y = Slider(0.585, range=0..1)
flange_thickness_x = Slider(0.341, range=0..1)
u_lock_placement = Slider(0.136, range=0..0.5)
lip_thickness_x = Slider(0.15, range=0..1)

# ----
expression = Expression(x=stem_radius_x, y=u_lock_radius, thick=ulock_clip_thickness, Expression="x + .125 + 2*y+thick")
expression_2 = Expression(x=stem_radius_x, y=u_lock_radius, Expression="x + .25 + y")
xz = XZPlane(Origin=Point(0, 0, 0))
expression_3 = Expression(x=u_lock_placement, y=u_lock_radius, Expression="y+x+.2")
cir = Circle(Plane=PlaneXY(0, 0, 0), Radius=1)
origin = Point(Point(0, 0, 0))
vec = VectorXYZ(XComponent=stem_radius_x, YComponent=0, ZComponent=0)  # -> Vector, Length
pt = Point(Point(0, 0, 0))
vec_2 = VectorXYZ(XComponent=spline_adjuster, YComponent=0, ZComponent=expression_3)  # -> Vector, Length
vec_3 = VectorXYZ(XComponent=expression_2, YComponent=0, ZComponent=u_lock_placement)  # -> Vector, Length
vec_4 = VectorXYZ(XComponent=expression, YComponent=0, ZComponent=0)  # -> Vector, Length
vec_5 = VectorXYZ(XComponent=0, YComponent=0, ZComponent=bracket_height)  # -> Vector, Length
move = Move(Geometry=xz, Motion=vec_3.Vector)  # -> Geometry, Transform
move_2 = Move(Geometry=origin, Motion=vec.Vector)  # -> Geometry, Transform
move_3 = Move(Geometry=pt, Motion=vec_4.Vector)  # -> Geometry, Transform

vec_6 = VectorXYZ(XComponent=0, YComponent=stem_radius_y, ZComponent=0)  # -> Vector, Length
vec_7 = VectorXYZ(XComponent=flange_thickness_x, YComponent=flange_height_y, ZComponent=0)  # -> Vector, Length
move_4 = Move(Geometry=origin, Motion=vec_6.Vector)  # -> Geometry, Transform
move_5 = Move(Geometry=move_4.Geometry, Motion=vec_7.Vector)  # -> Geometry, Transform
lip_thickness_y = Slider(-0.25, range=-1..1)
rec_2pt = Rectangle2Pt(Plane=PlaneXY(0, 0, 0), PointA=move_4.Geometry, PointB=move_5.Geometry, Radius=0)  # -> Rectangle, Length
vec_8 = VectorXYZ(XComponent=lip_thickness_x, YComponent=lip_thickness_y, ZComponent=0)  # -> Vector, Length
move_6 = Move(Geometry=move_5.Geometry, Motion=vec_8.Vector)  # -> Geometry, Transform
boxrec = BoxRectangle(Rectangle=rec_2pt.Rectangle, Height=bracket_height)
rec_2pt_2 = Rectangle2Pt(Plane=PlaneXY(0, 0, 0), PointA=move_5.Geometry, PointB=move_6.Geometry, Radius=0)  # -> Rectangle, Length
boxrec_2 = BoxRectangle(Rectangle=rec_2pt_2.Rectangle, Height=bracket_height)
sunion = SolidUnion(Breps=[boxrec, boxrec_2])

move_7 = Move(Geometry=move_3.Geometry, Motion=vec_2.Vector)  # -> Geometry, Transform
move_8 = Move(Geometry=move_2.Geometry, Motion=vec_5.Vector)  # -> Geometry, Transform
inner_elipse = Ellipse(Plane=PlaneXY(0, 0, 0), Radius1=stem_radius_x, Radius2=stem_radius_y)  # -> Ellipse, Focus1, Focus2
intcrv = Interpolate(Vertices=[move_8.Geometry, move_7.Geometry, move_3.Geometry], Degree=3, Periodic=False, KnotStyle=1)  # -> Curve, Length, Domain
ln = Line(StartPoint=move_8.Geometry, EndPoint=move_2.Geometry)
vec_9 = VectorXYZ(XComponent=0, YComponent=10, ZComponent=0)  # -> Vector, Length
ln_2 = Line(StartPoint=move_2.Geometry, EndPoint=move_3.Geometry)
join = JoinCurves(Curves=[ln, intcrv.Curve, ln_2], Preserve=False)
cir_2 = Circle(Plane=move.Geometry, Radius=u_lock_radius)

# ---- group: Main Bracket
addition = Addition(A=stem_radius_x, B=bracket_thickness_x)
addition_2 = Addition(A=stem_radius_y, B=bracket_thickness_y)
Z = UnitZ(Factor=bracket_height)

# ----
outer_elipse = Ellipse(Plane=PlaneXY(0, 0, 0), Radius1=addition, Radius2=addition_2)  # -> Ellipse, Focus1, Focus2

# ---- group: Lock Holder
line = LineSDL(Start=move_2.Geometry, Direction=vec_9.Vector, Length=5)
ccx = CurveCurve(CurveA=line, CurveB=outer_elipse.Ellipse)  # -> Points, ParamsA, ParamsB

# ----
extr = Extrude(Base=inner_elipse.Ellipse, Direction=Z)
dist = Distance(PointA=ccx.Points, PointB=move_2.Geometry)
cap = CapHoles(Brep=extr)

# ---- group: Main Bracket (continued)
extr_2 = Extrude(Base=outer_elipse.Ellipse, Direction=Z)
cap_2 = CapHoles(Brep=extr_2)
sdiff = SolidDifference(BrepsA=cap_2, BrepsB=cap)
sdiff_cut_in_half = SolidDifference(BrepsA=sdiff, BrepsB=<geometry referenced from the Rhino model>)

# ----
vec_10 = VectorXYZ(XComponent=0, YComponent=dist, ZComponent=0)  # -> Vector, Length
extr_3 = Extrude(Base=join, Direction=vec_10.Vector)
extr_4 = Extrude(Base=cir_2, Direction=vec_10.Vector)
capex = CapHolesEx(Brep=extr_3)  # -> Brep, Caps, Solid
sdiff_2 = SolidDifference(BrepsA=capex.Brep, BrepsB=extr_4)
mirror = Mirror(Geometry=[sunion, sdiff_2], Plane=Plane(origin=(0, 0, 0), x=(0, 0, 1), y=(1, 0, 0)))  # -> flatten(Geometry), Transform
sunion_2 = SolidUnion(Breps=flatten([mirror.Geometry, sdiff_cut_in_half, sunion, sdiff_2]))
fmerge = MergeFaces(Brep=sunion_2)  # -> Breps, Before, After
